# Dynamo graph ChangeSysPath.dyn (Dynamo 2.13.1.3887)

string = StringInput("ChangeSysPath.py")  # graph input
file_from_path = FileObject(path=string)
readText = FileSystem.ReadText(file=file_from_path)

# group: Reoad
reload = BoolSelector(true)

continue_ = BoolSelector(false)  # graph input
reverse = BoolSelector(false)  # graph input
select_model_element = DSModelElementSelection()  # nothing selected
python_script_from_string = PythonStringNode(script=readText, IN[0]=file_from_path, IN[1]=reload, IN[2]=continue_, IN[3]=reverse, IN[4]=select_model_element)  # IronPython2
string_2 = StringInput("Part1_CreatePointList.py")  # graph input
string_3 = StringInput("Part2_ChangeSysPath.py")  # graph input
string_4 = StringInput("Part3_CalculateTraysParameters.py")  # graph input
string_5 = StringInput("Part4_CheckHealth.py")  # graph input
